# Grasshopper definition EC01240622.gh (Grasshopper 1.0.7)
# Copyright: Copyrights
# plug-ins: Parakeet

number_slider = Slider(3, range=0..3)
holder_width = Slider(24, range=22..32)
holder_thickness = Slider(2, range=2..10)
holder_height = Slider(58, range=0..100)
construct_point = ConstructPoint(XCoordinate=0, YCoordinate=0, ZCoordinate=0)
arc_length = GetNumber(Slider(2.4, range=2..2.4), AtLeast=1, AtMost=1, Maximum=1.797693135e+308, Minimum=-1.797693135e+308, TreeAccess=False)
cells = GetNumber(Slider(100, range=0..200), AtLeast=1, AtMost=1, Maximum=1.797693135e+308, Minimum=-1.797693135e+308, TreeAccess=False)
number_slider_2 = Slider(1.02, range=0..10)
offset = GetNumber(Slider(0.6, range=0..3), AtLeast=1, AtMost=1, Maximum=1.797693135e+308, Minimum=-1.797693135e+308, TreeAccess=False)
unit_z = UnitZ(Factor=Slider(0.1, range=0..1))

# ---- group: Sphere
number_slider_3 = Slider(70, range=50..100)
construct_domain = ConstructDomain(DomainStart=Slider(0.7, range=0.1..3), DomainEnd=arc_length)
yz_plane = YZPlane(Origin=Point(0, 0, 0))
construct_point_2 = ConstructPoint(XCoordinate=0, YCoordinate=0, ZCoordinate=0)
unit_z_2 = UnitZ(Factor=1)
line_sdl = LineSDL(Start=construct_point_2, Direction=unit_z_2, Length=1)

# ----
radius = GetNumber(number_slider_3, AtLeast=1, AtMost=1, Maximum=1.797693135e+308, Minimum=-1.797693135e+308, TreeAccess=False)

# ---- group: Sphere (continued)
arc = Arc(Plane=yz_plane, Radius=radius, Angle=construct_domain)  # -> Arc, Length
rotate = Rotate(Geometry=arc.Arc, Angle=1.570796327, Plane=yz_plane)  # -> Geometry, Transform

# ----
scale_nu = ScaleNU(Geometry=rotate.Geometry, Plane=PlaneXY(0, 0, 0), ScaleX=1, ScaleY=1, ScaleZ=Slider(1.15, range=1..2))  # -> Geometry, Transform

# ---- group: Sphere (continued)
revolution = Revolution(Curve=scale_nu.Geometry, Axis=line_sdl, Domain=Domain(0, 6.283185307))

# ----
dimensions = Dimensions(Surface=revolution)  # -> UDimension, VDimension
addition = Addition(A=dimensions.VDimension, B=10)
addition_2 = Addition(A=dimensions.UDimension, B=10)
plane_surface = PlaneSurface(Plane=PlaneXY(0, 0, 0), XSize=addition_2, YSize=addition)
populate_geometry = PopulateGeometry(Geometry=plane_surface, Count=cells, Seed=1)
voronoi_on_surface = VoronoiOnSurface(Points=populate_geometry, Target=plane_surface)

scale_nu_2 = ScaleNU(Geometry=revolution, Plane=PlaneXY(0, 0, 0), ScaleX=number_slider_2, ScaleY=number_slider_2, ScaleZ=1)  # -> Geometry, Transform
offset_curve = OffsetCurve(Curve=voronoi_on_surface, Distance=expr("-x", offset), Corners=3)
area = Area(Geometry=offset_curve)  # -> Area, Centroid
flip = Flip(Surface=scale_nu_2.Geometry)  # -> Surface, Result

scale = Scale(Geometry=offset_curve, Center=area.Centroid, Factor=Slider(0.9, range=0..1))  # -> Geometry, Transform
vector_xyz = VectorXYZ(XComponent=0, YComponent=expr("-x", Slider(0.5, range=0..10)), ZComponent=Slider(0.5, range=0..10))  # -> Vector, Length
move = Move(Geometry=scale.Geometry, Motion=vector_xyz.Vector)  # -> Geometry, Transform

brep_edges = BrepEdges(Brep=scale_nu_2.Geometry)  # -> Naked, Interior, NonManifold
brep_edges_2 = BrepEdges(Brep=revolution)  # -> Naked, Interior, NonManifold
scale_2 = Scale(Geometry=offset_curve, Center=area.Centroid, Factor=Slider(0.99, range=0..1))  # -> Geometry, Transform
area_2 = Area(Geometry=brep_edges_2.Naked)  # -> Area, Centroid
list_item = ListItem(List=area_2.Centroid, Index=0, Wrap=True)

# ---- group: Holder
cluster = Cluster_2(
    geometry_2=list_item,
    plane_2=list_item,
    factor=holder_thickness,
    B_4=holder_thickness,
    geometry_4=list_item,
    A_3=holder_height,
    B_3=holder_thickness,
    A_4=holder_width,
    B_5=holder_thickness,
    geometry=list_item,
    plane=list_item,
    radius=holder_width,
    A_2=holder_height,
    A=holder_thickness,
    radius_2=holder_width,
    geometry_5=list_item,
    B_2=number_slider,
    A_5=holder_width,
    B_6=number_slider,
    geometry_3=list_item,
    B=number_slider)  # -> loft_4, surfaces_2, circle_9, circle_10, loft_3, surfaces, circle_11

# ----
divide_curve = DivideCurve(Curve=cluster.circle_9, Count=Slider(60, range=0..100), Kinks=False)  # -> Points, Tangents, Parameters
loft = Loft(
    Curves=[cluster.circle_9, cluster.circle_10],
    Options={Adjust=False, Closed=False, LoftEnds=0, LoftSimp=0, LoftType=0, Rebuild=10, Refit=0.01})

list_item_2 = ListItem(List=divide_curve.Points, Index=0, Wrap=True)
cluster_2 = Cluster(curve=cluster.circle_11)  # -> sphere_2, centroid, loft_2, extrusion
brep_join = BrepJoin(Breps=[cluster.loft_4, cluster.surfaces_2, cluster.loft_3, cluster.surfaces])  # -> Breps, Closed
mesh_brep = MeshBrep(
    Brep=cluster_2.loft_2,
    Settings={GridMaxCount=0, GridMinCount=16, JaggedSeams=False, MaxEdgeLength=0, MinEdgeLength=0.0001, MinTolerance=0, Refine=True, RefineAngle=0, RelativeTolerance=0.65, SimplePlanes=True, Tolerance=0})
mesh_brep_2 = MeshBrep(
    Brep=cluster_2.extrusion,
    Settings={GridMaxCount=0, GridMinCount=16, JaggedSeams=False, MaxEdgeLength=0, MinEdgeLength=0.0001, MinTolerance=0, Refine=True, RefineAngle=0, RelativeTolerance=0.65, SimplePlanes=True, Tolerance=0})
mesh_brep_3 = MeshBrep(
    Brep=cluster_2.sphere_2,
    Settings={GridMaxCount=0, GridMinCount=16, JaggedSeams=False, MaxEdgeLength=0, MinEdgeLength=0.0001, MinTolerance=0, Refine=True, RefineAngle=0, RelativeTolerance=0.65, SimplePlanes=True, Tolerance=0})

# ---- group: Ribs / Isocurves
line_sdl_2 = LineSDL(Start=divide_curve.Points, Direction=expr("-X", Vector(0, 0, 1)), Length=Slider(2, range=0..50))
offset_on_srf = OffsetOnSrf(Curve=line_sdl_2, Distance=Slider(2, range=0..10), Surface=loft)
edge_surface = EdgeSurface(CurveA=flatten(offset_on_srf), CurveB=line_sdl_2)

# ----
context_bake = ContextBake(BulbHolder=mesh_brep)
context_bake_2 = ContextBake(Content=mesh_brep_2)
context_bake_3 = ContextBake(Content=mesh_brep_3)
graft_tree = GraftTree(Tree=scale_2.Geometry, IncludeEmptyLists=True, IncludeNullItems=True)
graft_tree_2 = GraftTree(Tree=move.Geometry, IncludeEmptyLists=True, IncludeNullItems=True)
graft_tree_3 = GraftTree(Tree=brep_edges.Naked, IncludeEmptyLists=True, IncludeNullItems=True)
graft_tree_4 = GraftTree(Tree=brep_edges_2.Naked, IncludeEmptyLists=True, IncludeNullItems=True)
loft_2 = Loft(
    Curves=[graft_tree_2, graft_tree],
    Options={Adjust=False, Closed=False, LoftEnds=0, LoftSimp=0, LoftType=0, Rebuild=10, Refit=0.01})
boundary_surfaces = BoundarySurfaces(Edges=[graft_tree_4, graft_tree_3])
surface = Surface(move.Geometry)
surface_2 = Surface(scale_2.Geometry)
brep_join_2 = BrepJoin(Breps=flatten([surface, loft_2, surface_2]))  # -> Breps, Closed
bounding_box = BoundingBox(Content=flatten(brep_join_2.Breps), Plane=PlaneXY(0, 0, 0), UnionBox=True)  # -> Box, Box_2
brep_join_3 = BrepJoin(Breps=flatten([boundary_surfaces, revolution, scale_nu_2.Geometry]))  # -> Breps, Closed
move_2 = Move(Geometry=bounding_box.Box, Motion=unit_z)  # -> Geometry, Transform
surface_morph = SurfaceMorph(
    Geometry=brep_join_2.Breps,
    Reference=move_2.Geometry,
    Surface=reparameterize(flip.Surface),
    UDomain=Slider(0.5, range=0..1),
    VDomain=Slider(1, range=0..1),
    WDomain=Slider(0.5, range=0..1))
mirror = Mirror(Geometry=surface_morph, Plane=PlaneYZ(0, 0, 0))  # -> Geometry, Transform
brep_join_4 = BrepJoin(Breps=flatten([surface_morph, mirror.Geometry]))  # -> Breps, Closed
mesh_brep_4 = MeshBrep(
    Brep=brep_join_4.Breps,
    Settings={GridMaxCount=0, GridMinCount=16, JaggedSeams=False, MaxEdgeLength=0, MinEdgeLength=0.0001, MinTolerance=0, Refine=True, RefineAngle=0, RelativeTolerance=0.65, SimplePlanes=True, Tolerance=0})
mesh_brep_5 = MeshBrep(
    Brep=brep_join_3.Breps,
    Settings={GridMaxCount=0, GridMinCount=16, JaggedSeams=False, MaxEdgeLength=0, MinEdgeLength=0.0001, MinTolerance=0, Refine=True, RefineAngle=0, RelativeTolerance=0.65, SimplePlanes=True, Tolerance=0})
solid_union = SolidUnion(Breps=[brep_join_3.Breps, brep_join_4.Breps])  # disabled
context_bake_4 = ContextBake(CracksSurface=mesh_brep_4)
context_bake_5 = ContextBake(BaseSurface=mesh_brep_5)

# ---- group: Ribs
offset_surface = OffsetSurface(Surface=edge_surface, Distance=Slider(100, range=0..1000), Retrim=True)
graft_tree_5 = GraftTree(Tree=edge_surface, IncludeEmptyLists=True, IncludeNullItems=True)
graft_tree_6 = GraftTree(Tree=offset_surface, IncludeEmptyLists=True, IncludeNullItems=True)
loft_3 = Loft(
    Curves=[graft_tree_5, graft_tree_6],
    Options={Adjust=False, Closed=False, LoftEnds=0, LoftSimp=0, LoftType=0, Rebuild=10, Refit=0.01})
brep_brep = BrepBrep(BrepA=loft_3, BrepB=revolution)  # -> Curves, Points
split_brep = SplitBrep(Brep=loft_3, Cutter=revolution)
surface_split = SurfaceSplit(Surface=revolution, Curves=flatten(brep_brep.Curves))

cull_index = CullIndex(List=surface_split, Indices=0, Wrap=True)
list_item_3 = ListItem(List=split_brep, Index=0, Wrap=True)

brep_join_5 = BrepJoin(Breps=flatten([list_item_3, cull_index]))  # -> Breps, Closed
cap_holes = CapHoles(Brep=brep_join_5.Breps)

# ----
# textured surface
solid_union_2 = SolidUnion(Breps=flatten([brep_join.Breps, cap_holes]))
mesh_brep_6 = MeshBrep(
    Brep=flatten(solid_union_2),
    Settings={GridMaxCount=0, GridMinCount=16, JaggedSeams=False, MaxEdgeLength=0, MinEdgeLength=0.0001, MinTolerance=0, Refine=True, RefineAngle=0, RelativeTolerance=0.65, SimplePlanes=True, Tolerance=0})
# print solid textured surface
solid_union_3 = SolidUnion(Breps=[solid_union_2, solid_union])  # disabled
context_bake_6 = ContextBake(RibsHolder=mesh_brep_6)
custom_preview = CustomPreview(
    Geometry=[mesh_brep_5, mesh_brep_4, mesh_brep_6],
    Material={diffuse=RGB(221, 160, 221), emission=RGB(66, 48, 66), shine=0.5, specular=RGB(255, 255, 255), transparency=0})

# ==== cluster Cluster
curve = ClusterInput()

# ---- group: bulb holder
unit_z = UnitZ(Factor=Slider(12, range=0..200))
offset_curve = OffsetCurve(Curve=curve, Distance=expr("-x", Slider(7, range=0..10)), Corners=1)
move = Move(Geometry=offset_curve, Motion=unit_z)  # -> Geometry, Transform
unit_z_2 = UnitZ(Factor=Slider(14, range=0..20))
number_slider = Slider(5, range=0..10)
unit_z_3 = UnitZ(Factor=Slider(3, range=0..20))
linear_array = LinearArray(Geometry=move.Geometry, Direction=unit_z_3, Count=number_slider)  # -> Geometry, Transform
range = Range(Domain=Domain(0.001, 1), Steps=expr("x-1", number_slider))
area = Area(Geometry=linear_array.Geometry)  # -> Area, Centroid
graph_mapper = GraphMapper(range, x0=0, x1=1, y0=0, y1=1, Cx=0.2244333476, Cy=0.6737938523, container_name="Conic")
scale = Scale(Geometry=reverse(linear_array.Geometry), Center=reverse(area.Centroid), Factor=graph_mapper)  # -> Geometry, Transform
insert_items = InsertItems(List=scale.Geometry, Item=offset_curve, Indices=-1, Wrap=True)
loft = Loft(Curves=insert_items, Options={Adjust=False, Closed=False, LoftEnds=0, LoftSimp=0, LoftType=0, Rebuild=10, Refit=0.01})

# ----
area_2 = Area(Geometry=offset_curve)  # -> Area, Centroid
list_item = ListItem(List=area.Centroid, Index=-1, Wrap=True)

# ---- group: chord
circle = Circle(Plane=list_item, Radius=Slider(1, range=0..10))
unit_z_4 = UnitZ(Factor=Slider(200, range=0..250))
extrude = Extrude(Base=circle, Direction=unit_z_4)

# ----
centroid = ClusterOutput(area.Centroid)
unit_z_5 = UnitZ(Factor=Slider(15, range=0..100))
move_2 = Move(Geometry=area_2.Centroid, Motion=expr("-x", unit_z_5))  # -> Geometry, Transform
sphere = Sphere(Base=move_2.Geometry, Radius=Slider(20, range=0..100))
extrusion = ClusterOutput(extrude)
sphere_2 = ClusterOutput(sphere)
loft_2 = ClusterOutput(loft)

# ==== cluster Cluster_2
A = ClusterInput()
B = ClusterInput()
B_2 = ClusterInput()
A_2 = ClusterInput()
geometry = ClusterInput()
geometry_2 = ClusterInput()
factor = ClusterInput()
geometry_3 = ClusterInput()
geometry_4 = ClusterInput()
geometry_5 = ClusterInput()
A_3 = ClusterInput()
B_3 = ClusterInput()
B_4 = ClusterInput()
A_4 = ClusterInput()
B_5 = ClusterInput()
A_5 = ClusterInput()
B_6 = ClusterInput()
plane = ClusterInput()
radius = ClusterInput()
plane_2 = ClusterInput()
subtraction = Subtraction(A=A_5, B=B_6)
radius_2 = ClusterInput()

# ---- group: inner
multiplication = Multiplication(A=A, B=2)
subtraction_2 = Subtraction(A=A_2, B=multiplication)
addition = Addition(A=subtraction_2, B=B_2)
addition_2 = Addition(A=addition, B=B)
unit_z = UnitZ(Factor=subtraction_2)
move = Move(Geometry=geometry, Motion=expr("-x", unit_z))  # -> Geometry, Transform
unit_z_2 = UnitZ(Factor=addition_2)
move_2 = Move(Geometry=geometry_3, Motion=expr("-x", unit_z_2))  # -> Geometry, Transform
circle = Circle(Plane=plane, Radius=radius)
circle_2 = Circle(Plane=move.Geometry, Radius=radius_2)
circle_3 = Circle(Plane=move_2.Geometry, Radius=subtraction)

# ---- group: outer
unit_z_3 = UnitZ(Factor=factor)
move_3 = Move(Geometry=geometry_2, Motion=expr("-x", unit_z_3))  # -> Geometry, Transform
addition_3 = Addition(A=A_3, B=B_3)
unit_z_4 = UnitZ(Factor=addition_3)
move_4 = Move(Geometry=geometry_4, Motion=expr("-x", unit_z_4))  # -> Geometry, Transform
addition_4 = Addition(A=A_4, B=B_5)
addition_5 = Addition(A=addition_4, B=B_4)
circle_4 = Circle(Plane=plane_2, Radius=addition_5)
circle_5 = Circle(Plane=move_3.Geometry, Radius=addition_5)
circle_6 = Circle(Plane=move_3.Geometry, Radius=addition_4)
circle_7 = Circle(Plane=move_4.Geometry, Radius=addition_4)
loft = Loft(
    Curves=[circle_4, circle_5, circle_6, circle_7],
    Options={Adjust=False, Closed=False, LoftEnds=0, LoftSimp=0, LoftType=3, Rebuild=10, Refit=0.01})
boundary_surfaces = BoundarySurfaces(Edges=[circle_4, circle])

# ----
unit_z_5 = UnitZ(Factor=addition)
move_5 = Move(Geometry=geometry_5, Motion=expr("-x", unit_z_5))  # -> Geometry, Transform

# ---- group: inner (continued)
circle_8 = Circle(Plane=move_5.Geometry, Radius=subtraction)
loft_2 = Loft(
    Curves=[circle, circle_2, circle_8, circle_3],
    Options={Adjust=False, Closed=False, LoftEnds=0, LoftSimp=0, LoftType=3, Rebuild=10, Refit=0.01})
boundary_surfaces_2 = BoundarySurfaces(Edges=[circle_7, circle_3])

# ----
circle_9 = ClusterOutput(circle)
circle_10 = ClusterOutput(circle_2)
circle_11 = ClusterOutput(circle_3)
loft_3 = ClusterOutput(loft_2)
loft_4 = ClusterOutput(loft)
surfaces = ClusterOutput(boundary_surfaces_2)
surfaces_2 = ClusterOutput(boundary_surfaces)
