# Grasshopper definition HoneyTanil.gh (Grasshopper 1.0.7)
# plug-ins: LunchBox

number_slider = Slider(10, range=0..10)
height = GetNumber(Slider(2, range=0..10), AtLeast=1, AtMost=1, Maximum=1.797693135e+308, Minimum=-1.797693135e+308, TreeAccess=False)
range = Range(Domain=Domain(0, 1), Steps=expr("x-1", number_slider))
series = Series(Start=0, Step=height, Count=number_slider)
construct_point = ConstructPoint(XCoordinate=0, YCoordinate=0, ZCoordinate=series)
graph_mapper = GraphMapper(range, x0=0, x1=1, y0=0, y1=1, Ox=0.4907562137, Oy=0.6747657657, Px=0.75, Py=0.25, container_name="Parabola")
min = GetNumber(Slider(3, range=0..10), AtLeast=1, AtMost=1, Maximum=1.797693135e+308, Minimum=-1.797693135e+308, TreeAccess=False)
max = GetNumber(Slider(4, range=0..10), AtLeast=1, AtMost=1, Maximum=1.797693135e+308, Minimum=-1.797693135e+308, TreeAccess=False)
remap = Remap(data=graph_mapper, min=min, max=max)
polygon = Polygon(Plane=construct_point, Radius=remap, Segments=6, FilletRadius=Slider(2, range=0..10))  # -> Polygon, Length
loft = Loft(Curves=polygon.Polygon, Options={Adjust=False, Closed=False, LoftEnds=0, LoftSimp=0, LoftType=0, Rebuild=10, Refit=0.01})
offset_surface = OffsetSurface(Surface=loft, Distance=Slider(0.5, range=0..1), Retrim=True)
u_div = GetNumber(Slider(20, range=0..100), AtLeast=1, AtMost=1, Maximum=1.797693135e+308, Minimum=-1.797693135e+308, TreeAccess=False)
v_div = GetNumber(Slider(18, range=0..100), AtLeast=1, AtMost=1, Maximum=1.797693135e+308, Minimum=-1.797693135e+308, TreeAccess=False)
hexagon_cells = HexagonCells(Surface=offset_surface, UDivisions=u_div, VDivisions=v_div, TParameter=0.25)  # -> HexagonCells, Centers
hexagon_cells_2 = HexagonCells(Surface=loft, UDivisions=u_div, VDivisions=v_div, TParameter=0.25)  # -> HexagonCells, Centers
scale = Scale(Geometry=hexagon_cells_2.HexagonCells, Center=hexagon_cells_2.Centers, Factor=0.9)  # -> Geometry, Transform
vector_2pt = Vector2Pt(PointA=hexagon_cells_2.Centers, PointB=hexagon_cells.Centers, Unitize=False)  # -> Vector, Length
fillet = Fillet(Curve=scale.Geometry, Radius=Slider(0.5, range=0..1))
scale_2 = Scale(Geometry=fillet, Center=hexagon_cells_2.Centers, Factor=0.5)  # -> Geometry, Transform
amplitude = Amplitude(Vector=vector_2pt.Vector, Amplitude=expr("-x", Slider(0.2, range=0..1)))
amplitude_2 = Amplitude(Vector=vector_2pt.Vector, Amplitude=Slider(0.3, range=0..1))
move = Move(Geometry=scale_2.Geometry, Motion=amplitude_2)  # -> Geometry, Transform
graft_tree = GraftTree(Tree=fillet, IncludeEmptyLists=True, IncludeNullItems=True)
graft_tree_2 = GraftTree(Tree=hexagon_cells_2.HexagonCells, IncludeEmptyLists=True, IncludeNullItems=True)
graft_tree_3 = GraftTree(Tree=move.Geometry, IncludeEmptyLists=True, IncludeNullItems=True)
move_2 = Move(Geometry=hexagon_cells.Centers, Motion=amplitude)  # -> Geometry, Transform
loft_2 = Loft(
    Curves=[graft_tree, graft_tree_3],
    Options={Adjust=False, Closed=False, LoftEnds=0, LoftSimp=0, LoftType=0, Rebuild=10, Refit=0.01})
loft_3 = Loft(
    Curves=[graft_tree, graft_tree_2],
    Options={Adjust=False, Closed=False, LoftEnds=0, LoftSimp=0, LoftType=1, Rebuild=10, Refit=0.01})
extrude_point = ExtrudePoint(Base=move.Geometry, Point=move_2.Geometry)
merge = Merge(Data1=loft_3, Data2=loft_2, Data3=extrude_point)
brep_wireframe = BrepWireframe(Brep=merge, Density=-1)
mesh_brep = MeshBrep(
    Brep=merge,
    Settings={GridMaxCount=0, GridMinCount=16, JaggedSeams=False, MaxEdgeLength=0, MinEdgeLength=0.0001, MinTolerance=0, Refine=True, RefineAngle=0, RelativeTolerance=0.65, SimplePlanes=True, Tolerance=0})
weld_mesh = WeldMesh(Mesh=mesh_brep, Angle=3.141592654)
context_bake = ContextBake(Content=brep_wireframe)
context_bake_2 = ContextBake(Content=weld_mesh)
create_material = CreateMaterial(Diffuse=RGB(255, 105, 180), Specular=RGB(255, 255, 255), Emission=RGB(0, 0, 0), Transparency=0, Shine=0)

# ==== cluster Remap: Remaps numbers
data = ClusterInput()
min = ClusterInput()
max = ClusterInput()
bnd = Bounds(Numbers=data)
dom = ConstructDomain(DomainStart=min, DomainEnd=max)
remap = RemapNumbers(Value=data, Source=bnd, Target=dom)  # -> Mapped, Clipped
R = ClusterOutput(remap.Mapped)
