# Grasshopper definition W01240622.gh (Grasshopper 1.0.7)
# Copyright: Copyrights

construct_point = ConstructPoint(XCoordinate=0, YCoordinate=0, ZCoordinate=0)
number_slider = Slider(3, range=0..3)
holder_width = Slider(24, range=22..32)
holder_thickness = Slider(2, range=2..10)
holder_height = Slider(58, range=0..100)
unit_z = UnitZ(Factor=Slider(0.03, range=0..0.1))
move = Move(Geometry=construct_point, Motion=unit_z)  # -> Geometry, Transform

# ---- group: Holder
cluster = Cluster_2(
    geometry_2=construct_point,
    plane_2=construct_point,
    factor=holder_thickness,
    B_4=holder_thickness,
    geometry_4=construct_point,
    A_3=holder_height,
    B_3=holder_thickness,
    A_4=holder_width,
    B_5=holder_thickness,
    geometry=construct_point,
    plane=construct_point,
    radius=holder_width,
    A_2=holder_height,
    A=holder_thickness,
    radius_2=holder_width,
    geometry_5=construct_point,
    B_2=number_slider,
    A_5=holder_width,
    B_6=number_slider,
    geometry_3=construct_point,
    B=number_slider)  # -> loft_4, surfaces_2, circle_9, circle_10, loft_3, surfaces, circle_11

# ----
cluster_2 = Cluster(curve=cluster.circle_11)  # -> sphere_2, centroid, loft_2, extrusion

divide_curve = DivideCurve(Curve=cluster.circle_9, Count=Slider(60, range=0..100), Kinks=False)  # -> Points, Tangents, Parameters
loft = Loft(
    Curves=[cluster.circle_9, cluster.circle_10],
    Options={Adjust=False, Closed=False, LoftEnds=0, LoftSimp=0, LoftType=0, Rebuild=10, Refit=0.01})

list_item = ListItem(List=divide_curve.Points, Index=0, Wrap=True)
mesh_brep = MeshBrep(
    Brep=cluster_2.loft_2,
    Settings={GridMaxCount=0, GridMinCount=16, JaggedSeams=False, MaxEdgeLength=0, MinEdgeLength=0.0001, MinTolerance=0, Refine=True, RefineAngle=0, RelativeTolerance=0.65, SimplePlanes=True, Tolerance=0})
mesh_brep_2 = MeshBrep(
    Brep=cluster_2.extrusion,
    Settings={GridMaxCount=0, GridMinCount=16, JaggedSeams=False, MaxEdgeLength=0, MinEdgeLength=0.0001, MinTolerance=0, Refine=True, RefineAngle=0, RelativeTolerance=0.65, SimplePlanes=True, Tolerance=0})
mesh_brep_3 = MeshBrep(
    Brep=cluster_2.sphere_2,
    Settings={GridMaxCount=0, GridMinCount=16, JaggedSeams=False, MaxEdgeLength=0, MinEdgeLength=0.0001, MinTolerance=0, Refine=True, RefineAngle=0, RelativeTolerance=0.65, SimplePlanes=True, Tolerance=0})
brep_join = BrepJoin(Breps=[cluster.loft_4, cluster.surfaces_2, cluster.loft_3, cluster.surfaces])  # -> Breps, Closed

# ---- group: Ribs / Isocurves
line_sdl = LineSDL(Start=divide_curve.Points, Direction=expr("-X", Vector(0, 0, 1)), Length=Slider(2, range=0..50))
offset_on_srf = OffsetOnSrf(Curve=line_sdl, Distance=Slider(2, range=0..10), Surface=loft)
edge_surface = EdgeSurface(CurveA=flatten(offset_on_srf), CurveB=line_sdl)

# ----
context_bake = ContextBake(BulbHolder=mesh_brep)
context_bake_2 = ContextBake(Content=mesh_brep_2)
context_bake_3 = ContextBake(Content=mesh_brep_3)
mesh_brep_4 = MeshBrep(
    Brep=brep_join.Breps,
    Settings={GridMaxCount=0, GridMinCount=16, JaggedSeams=False, MaxEdgeLength=0, MinEdgeLength=0.0001, MinTolerance=0, Refine=True, RefineAngle=0, RelativeTolerance=0.65, SimplePlanes=True, Tolerance=0})
context_bake_4 = ContextBake(Content=mesh_brep_4)
xz_plane = XZPlane(Origin=Point(0, 0, 0))
shader = Shader({diffuse=RGB(145, 112, 54), emission=RGB(0, 0, 0), shine=0.76, specular=RGB(178, 178, 178), transparency=0.29})
object_material = ObjectMaterial(<object material referenced from the Rhino model>)
render_material = RenderMaterial(Source=0, Material=object_material)  # -> ObjectMaterial, Source, Material
model_material = ModelMaterial(Material=object_material, Name="Amber", Shader=shader)  # -> Material, Name, Shader

number_slider_2 = Slider(20, range=14..26)
range = Range(Domain=Domain(0, 1), Steps=expr("x-1", number_slider_2))
unit_z_2 = UnitZ(Factor=Slider(10, range=0..10))
graph_mapper = GraphMapper(
    range,
    x0=0,
    x1=1,
    y0=0,
    y1=1,
    container_name="Sinc",
    Equation_X0=0.4666849673,
    Equation_X1=0.8094201684,
    Equation_Y0=0.8442390561,
    Equation_Y1=0.2623189092)

height = GetNumber(number_slider_2, AtLeast=1, AtMost=1, Maximum=1.797693135e+308, Minimum=-1.797693135e+308, TreeAccess=False)
largest_radius = GetNumber(Slider(78.1, range=60..100), AtLeast=1, AtMost=1, Maximum=1.797693135e+308, Minimum=-1.797693135e+308, TreeAccess=False)
edge_radius = GetNumber(Slider(36, range=30..60), AtLeast=1, AtMost=1, Maximum=1.797693135e+308, Minimum=-1.797693135e+308, TreeAccess=False)

linear_array = LinearArray(Geometry=move.Geometry, Direction=expr("-X", unit_z_2), Count=height)  # -> Geometry, Transform
remap = Remap(data=graph_mapper, min=edge_radius, max=largest_radius)

# ---- group: smooth surface
circle = Circle(Plane=linear_array.Geometry, Radius=remap)

# ---- group: Star option
perp_frames = PerpFrames(Curve=circle, Count=Slider(40, range=0..40), Align=True)  # -> Frames, Parameters
deconstruct_plane = DeconstructPlane(Plane=perp_frames.Frames)  # -> Origin, XAxis, YAxis, ZAxis
dispatch = Dispatch(List=deconstruct_plane.XAxis, DispatchPattern=[True, False])  # -> ListA, ListB
dispatch_2 = Dispatch(List=deconstruct_plane.Origin, DispatchPattern=[True, False])  # -> ListA, ListB
amplitude = Amplitude(Vector=dispatch.ListA, Amplitude=Slider(5, range=0..10))
move_2 = Move(Geometry=dispatch_2.ListA, Motion=expr("-x", amplitude))  # -> Geometry, Transform
weave = Weave(Pattern=[0, 1], Stream0=move_2.Geometry, Stream1=dispatch_2.ListB, NullGaps=False)
interpolate = Interpolate(Vertices=weave, Degree=3, Periodic=True, KnotStyle=1)  # -> Curve, Length, Domain

# ----
list_item_2 = ListItem(List=circle, Index=-1, Wrap=True)
radial_dimension = RadialDimension(Curve=list_item_2, CurvePoint=list_item, DimensionLocation=Point(2.04480642, 0, 1.399859177))  # -> RadialDimension, DimensionType, CenterPoint, CurvePoint, DimensionLocation

range_2 = Range(Domain=Domain(0, 1), Steps=expr("x-1", number_slider_2))
graph_mapper_2 = GraphMapper(
    range_2,
    x0=0,
    x1=1,
    y0=0,
    y1=1,
    container_name="Sinc",
    Equation_X0=0.4913046956,
    Equation_X1=0.9995718598,
    Equation_Y0=0.8043478131,
    Equation_Y1=0.2698201537)
remap_2 = Remap(data=graph_mapper_2, min=Slider(0, range=0..10), max=Slider(-45, range=-90..90))
# Connect the options here
rotate = Rotate(Geometry=flatten(interpolate.Curve), Angle=expr("-x", degrees(remap_2)), Plane=PlaneXY(0, 0, 0))  # -> Geometry, Transform

range_3 = Range(Domain=Domain(0, 1), Steps=expr("x-1", number_slider_2))
graph_mapper_3 = GraphMapper(
    range_3,
    x0=0,
    x1=1,
    y0=0,
    y1=1,
    container_name="Sinc",
    Equation_X0=0.4913046956,
    Equation_X1=0.8115941882,
    Equation_Y0=0.8043478131,
    Equation_Y1=0.1514492035)

twist = GetNumber(Slider(3, range=-15..15), AtLeast=1, AtMost=1, Maximum=1.797693135e+308, Minimum=-1.797693135e+308, TreeAccess=False)

remap_3 = Remap(data=graph_mapper_3, min=Slider(0, range=0..10), max=twist)
rotate_2 = Rotate(Geometry=rotate.Geometry, Angle=degrees(remap_3), Plane=xz_plane)  # -> Geometry, Transform

# ---- group: offset surface
# 0.8 1.2 1.4 thickness
number_slider_3 = Slider(1.2, range=0..1.8)
loft_2 = Loft(
    Curves=flatten(rotate_2.Geometry),
    Options={Adjust=False, Closed=False, LoftEnds=0, LoftSimp=0, LoftType=0, Rebuild=15, Refit=0.01})
offset_surface = OffsetSurface(Surface=loft_2, Distance=number_slider_3, Retrim=True)
brep_edges = BrepEdges(Brep=loft_2)  # -> Naked, Interior, NonManifold
brep_edges_2 = BrepEdges(Brep=offset_surface)  # -> Naked, Interior, NonManifold
graft_tree = GraftTree(Tree=brep_edges.Naked, IncludeEmptyLists=True, IncludeNullItems=True)
graft_tree_2 = GraftTree(Tree=brep_edges_2.Naked, IncludeEmptyLists=True, IncludeNullItems=True)
loft_3 = Loft(
    Curves=[graft_tree_2, graft_tree],
    Options={Adjust=False, Closed=False, LoftEnds=0, LoftSimp=0, LoftType=0, Rebuild=10, Refit=0.01})

# ----
brep_join_2 = BrepJoin(Breps=flatten([loft_3, loft_2, offset_surface]))  # -> Breps, Closed
mesh_brep_5 = MeshBrep(
    Brep=brep_join_2.Breps,
    Settings={GridMaxCount=0, GridMinCount=16, JaggedSeams=False, MaxEdgeLength=0, MinEdgeLength=0.0001, MinTolerance=0, Refine=True, RefineAngle=0, RelativeTolerance=0.65, SimplePlanes=True, Tolerance=0})
context_bake_5 = ContextBake(Content=mesh_brep_5)

# ---- group: Ribs
offset_surface_2 = OffsetSurface(Surface=edge_surface, Distance=Slider(100, range=0..1000), Retrim=True)
graft_tree_3 = GraftTree(Tree=edge_surface, IncludeEmptyLists=True, IncludeNullItems=True)
graft_tree_4 = GraftTree(Tree=offset_surface_2, IncludeEmptyLists=True, IncludeNullItems=True)
loft_4 = Loft(
    Curves=[graft_tree_3, graft_tree_4],
    Options={Adjust=False, Closed=False, LoftEnds=0, LoftSimp=0, LoftType=0, Rebuild=10, Refit=0.01})
brep_brep = BrepBrep(BrepA=loft_4, BrepB=loft_2)  # -> Curves, Points
split_brep = SplitBrep(Brep=loft_4, Cutter=loft_2)
surface_split = SurfaceSplit(Surface=loft_2, Curves=flatten(brep_brep.Curves))

cull_index = CullIndex(List=surface_split, Indices=0, Wrap=True)
list_item_3 = ListItem(List=split_brep, Index=1, Wrap=True)

brep_join_3 = BrepJoin(Breps=flatten([list_item_3, cull_index]))  # -> Breps, Closed
cap_holes = CapHoles(Brep=brep_join_3.Breps)

# ----
mesh_brep_6 = MeshBrep(
    Brep=cap_holes,
    Settings={GridMaxCount=0, GridMinCount=16, JaggedSeams=False, MaxEdgeLength=0, MinEdgeLength=0.0001, MinTolerance=0, Refine=True, RefineAngle=0, RelativeTolerance=0.65, SimplePlanes=True, Tolerance=0})
context_bake_6 = ContextBake(Content=mesh_brep_6)
# textured surface
solid_union = SolidUnion(Breps=[brep_join_2.Breps, brep_join.Breps, cap_holes])
custom_preview = CustomPreview(Geometry=solid_union, Material=shader)

# ==== cluster Remap: Remaps numbers
data = ClusterInput()
min = ClusterInput()
max = ClusterInput()
bnd = Bounds(Numbers=data)
dom = ConstructDomain(DomainStart=min, DomainEnd=max)
remap = RemapNumbers(Value=data, Source=bnd, Target=dom)  # -> Mapped, Clipped
R = ClusterOutput(remap.Mapped)

# ==== cluster Cluster
curve = ClusterInput()

# ---- group: bulb holder
unit_z = UnitZ(Factor=Slider(12, range=0..200))
offset_curve = OffsetCurve(Curve=curve, Distance=expr("-x", Slider(7, range=0..10)), Corners=1)
move = Move(Geometry=offset_curve, Motion=unit_z)  # -> Geometry, Transform
unit_z_2 = UnitZ(Factor=Slider(14, range=0..20))
number_slider = Slider(5, range=0..10)
unit_z_3 = UnitZ(Factor=Slider(3, range=0..20))
linear_array = LinearArray(Geometry=move.Geometry, Direction=unit_z_3, Count=number_slider)  # -> Geometry, Transform
range = Range(Domain=Domain(0.001, 1), Steps=expr("x-1", number_slider))
area = Area(Geometry=linear_array.Geometry)  # -> Area, Centroid
graph_mapper = GraphMapper(range, x0=0, x1=1, y0=0, y1=1, Cx=0.2244333476, Cy=0.6737938523, container_name="Conic")
scale = Scale(Geometry=reverse(linear_array.Geometry), Center=reverse(area.Centroid), Factor=graph_mapper)  # -> Geometry, Transform
insert_items = InsertItems(List=scale.Geometry, Item=offset_curve, Indices=-1, Wrap=True)
loft = Loft(Curves=insert_items, Options={Adjust=False, Closed=False, LoftEnds=0, LoftSimp=0, LoftType=0, Rebuild=10, Refit=0.01})

# ----
area_2 = Area(Geometry=offset_curve)  # -> Area, Centroid
list_item = ListItem(List=area.Centroid, Index=-1, Wrap=True)

# ---- group: chord
circle = Circle(Plane=list_item, Radius=Slider(1, range=0..10))
unit_z_4 = UnitZ(Factor=Slider(200, range=0..250))
extrude = Extrude(Base=circle, Direction=unit_z_4)

# ----
centroid = ClusterOutput(area.Centroid)
unit_z_5 = UnitZ(Factor=Slider(15, range=0..100))
move_2 = Move(Geometry=area_2.Centroid, Motion=expr("-x", unit_z_5))  # -> Geometry, Transform
sphere = Sphere(Base=move_2.Geometry, Radius=Slider(20, range=0..100))
extrusion = ClusterOutput(extrude)
sphere_2 = ClusterOutput(sphere)
loft_2 = ClusterOutput(loft)

# ==== cluster Cluster_2
A = ClusterInput()
B = ClusterInput()
B_2 = ClusterInput()
A_2 = ClusterInput()
geometry = ClusterInput()
geometry_2 = ClusterInput()
factor = ClusterInput()
geometry_3 = ClusterInput()
geometry_4 = ClusterInput()
geometry_5 = ClusterInput()
A_3 = ClusterInput()
B_3 = ClusterInput()
B_4 = ClusterInput()
A_4 = ClusterInput()
B_5 = ClusterInput()
A_5 = ClusterInput()
B_6 = ClusterInput()
plane = ClusterInput()
radius = ClusterInput()
plane_2 = ClusterInput()
subtraction = Subtraction(A=A_5, B=B_6)
radius_2 = ClusterInput()

# ---- group: inner
multiplication = Multiplication(A=A, B=2)
subtraction_2 = Subtraction(A=A_2, B=multiplication)
addition = Addition(A=subtraction_2, B=B_2)
addition_2 = Addition(A=addition, B=B)
unit_z = UnitZ(Factor=subtraction_2)
move = Move(Geometry=geometry, Motion=expr("-x", unit_z))  # -> Geometry, Transform
unit_z_2 = UnitZ(Factor=addition_2)
move_2 = Move(Geometry=geometry_3, Motion=expr("-x", unit_z_2))  # -> Geometry, Transform
circle = Circle(Plane=plane, Radius=radius)
circle_2 = Circle(Plane=move.Geometry, Radius=radius_2)
circle_3 = Circle(Plane=move_2.Geometry, Radius=subtraction)

# ---- group: outer
unit_z_3 = UnitZ(Factor=factor)
move_3 = Move(Geometry=geometry_2, Motion=expr("-x", unit_z_3))  # -> Geometry, Transform
addition_3 = Addition(A=A_3, B=B_3)
unit_z_4 = UnitZ(Factor=addition_3)
move_4 = Move(Geometry=geometry_4, Motion=expr("-x", unit_z_4))  # -> Geometry, Transform
addition_4 = Addition(A=A_4, B=B_5)
addition_5 = Addition(A=addition_4, B=B_4)
circle_4 = Circle(Plane=plane_2, Radius=addition_5)
circle_5 = Circle(Plane=move_3.Geometry, Radius=addition_5)
circle_6 = Circle(Plane=move_3.Geometry, Radius=addition_4)
circle_7 = Circle(Plane=move_4.Geometry, Radius=addition_4)
loft = Loft(
    Curves=[circle_4, circle_5, circle_6, circle_7],
    Options={Adjust=False, Closed=False, LoftEnds=0, LoftSimp=0, LoftType=3, Rebuild=10, Refit=0.01})
boundary_surfaces = BoundarySurfaces(Edges=[circle_4, circle])

# ----
unit_z_5 = UnitZ(Factor=addition)
move_5 = Move(Geometry=geometry_5, Motion=expr("-x", unit_z_5))  # -> Geometry, Transform

# ---- group: inner (continued)
circle_8 = Circle(Plane=move_5.Geometry, Radius=subtraction)
loft_2 = Loft(
    Curves=[circle, circle_2, circle_8, circle_3],
    Options={Adjust=False, Closed=False, LoftEnds=0, LoftSimp=0, LoftType=3, Rebuild=10, Refit=0.01})
boundary_surfaces_2 = BoundarySurfaces(Edges=[circle_7, circle_3])

# ----
circle_9 = ClusterOutput(circle)
circle_10 = ClusterOutput(circle_2)
circle_11 = ClusterOutput(circle_3)
loft_3 = ClusterOutput(loft_2)
loft_4 = ClusterOutput(loft)
surfaces = ClusterOutput(boundary_surfaces_2)
surfaces_2 = ClusterOutput(boundary_surfaces)
